# Dynamo graph Beam Optimizer.dyn (Dynamo 2.19.3.6394)

XZ = Plane.XZ()
beam_height_h_number_slider = DoubleSlider(81, range=25..100 step 1)  # graph input
beam_width_b_number_slider = DoubleSlider(74, range=25..100 step 1)  # graph input
byWidthLength = Rectangle.ByWidthLength(plane=XZ, width=beam_height_h_number_slider, length=beam_width_b_number_slider)
beam_flange_thickness_tf_number = DoubleSlider(12, range=1..12 step 1)  # "Beam Flange Thickness (tf) Number Slider"; graph input
code_block = CodeBlock(h=beam_height_h_number_slider, tf=beam_flange_thickness_tf_number) { holeHeight = h - 2*tf; }
beam_web_thickness_tw_number = DoubleSlider(25, range=1..25 step 1)  # "Beam Web Thickness (tw) Number Slider"; graph input
sub = beam_width_b_number_slider - beam_web_thickness_tw_number
code_block_2 = CodeBlock { 2; }
div = sub / code_block_2
code_block_3 = CodeBlock(holeWidth=div) { holeWidth; }
byWidthLength_2 = Rectangle.ByWidthLength(plane=XZ, width=code_block, length=code_block_3)
code_block_4 = CodeBlock(holeWidth=code_block_3, tw=beam_web_thickness_tw_number) { holeOffsetX_1 = (holeWidth/2) + (tw/2); holeOffsetX_2 = -((holeWidth/2) + (tw/2)); }
list_create = List.Create(item0=code_block_4.holeOffsetX_1, item1=code_block_4.holeOffsetX_2)
translate = Geometry.Translate(geometry=byWidthLength_2, xTranslation=list_create)

# group: FIX ERROR: If there is no "hole" only get the plate
byPatch = Surface.ByPatch(closedCurve=byWidthLength)
byPatch_2 = Surface.ByPatch(closedCurve=translate)
difference = Surface.Difference(surface=byPatch, others=byPatch_2)
isNull = Object.IsNull(object=difference)
if_ = RefactoredIf(test=isNull, true=byPatch, false=difference)

area = Surface.Area(surface=if_)
beam_length = CodeBlock { 5000; }
mul = area * beam_length
code_block_5 = CodeBlock(bHeight=beam_height_h_number_slider, bWidth=beam_width_b_number_slider, hHeight=code_block, hWidth=code_block_3, beamLength=beam_length)
# ---------- code_block_5.designscript (12 lines) ----------
bHeight;
bWidth;
hHeight;
hWidth;
/*Young Modulus Steel N/mm^2*/
EYoung = 210000;
/* Load in (N/m) */
P_load = 0.05;
/* M.I. in mm^4 */
I_y = ((bWidth * Math.Pow(bHeight,3))/12) - 2*((hWidth * Math.Pow(hHeight,3))/12);
M_max = (P_load * beamLength * beamLength) / 8;
f_max = (5*P_load*Math.Pow(beamLength, 4))/(384*EYoung*I_y);
# ----------------------------------------
M_max = Watch(code_block_5.M_max)  # graph output
cross_section = Watch(if_)  # graph output
code_block_6 = CodeBlock { "-"; }
list_create_2 = List.Create(item0=beam_height_h_number_slider, item1=beam_width_b_number_slider, item2=beam_web_thickness_tw_number, item3=beam_flange_thickness_tf_number)
floor = Math.Floor(number=list_create_2)
string_from_object = FromObject(object=floor)
join = String.Join(separator=code_block_6, string0=string_from_object)
code_block_7 = CodeBlock(str=join) { "C:\\temp\\test\\" + str + ".csv"; }
code_block_8 = CodeBlock { ["h","b","tw","tf","A","V","fmax","OK"]; }
cross_section_area = Watch(area)  # graph output
boolean = BoolSelector(false)
thicken = Surface.Thicken(surface=if_, thickness=beam_length, both_sides=boolean)
volume = Solid.Volume(solid=thicken)
material_volume = Watch(volume)  # graph output
f_max = Watch(code_block_5.f_max)  # graph output
code_block_9 = CodeBlock(L=beam_length)
# ---------- code_block_9.designscript (2 lines) ----------
// Limit
Lim = L/300;
# ----------------------------------------
lt = code_block_5.f_max < code_block_9
limit_pass = Watch(lt)  # graph output
list_create_3 = List.Create(item0=beam_height_h_number_slider, item1=beam_width_b_number_slider, item2=beam_web_thickness_tw_number, item3=beam_flange_thickness_tf_number, item4=cross_section_area, item5=material_volume, item6=f_max, item7=limit_pass)
list_create_4 = List.Create(item0=code_block_8, item1=list_create_3)
exportCSV = Data.ExportCSV(filePath=code_block_7, data=list_create_4)
code_block_10 = CodeBlock()
# ---------- code_block_10.designscript (5 lines) ----------
/// Beam Data
beamHeight = [25..100..1];
beamWidth = [25..100..1];
WebThickness = [1..25..1];
FlangeThickness = [1..12..1];
# ----------------------------------------
flatten = List.Flatten(list=code_block_10.beamHeight)
flatten_2 = List.Flatten(list=code_block_10.beamWidth)
mul_2 = flatten * flatten_2  # lacing=CrossProduct
