# Dynamo graph Beam Optimizer_no geometry.dyn (Dynamo 2.19.3.6394)

code_block = CodeBlock { _flangeArea; _; }  # unwired: flangeArea, arg1
code_block_2 = CodeBlock()
# ---------- code_block_2.designscript (5 lines) ----------
/// Beam Data
beamHeight = [25..100..1];
beamWidth = [25..100..1];
WebThickness = [1..25..1];
FlangeThickness = [1..25..1];
# ----------------------------------------
list_create = List.Create(item0=code_block_2.beamHeight, item1=code_block_2.beamWidth, item2=code_block_2.WebThickness, item3=code_block_2.FlangeThickness)
code_block_3 = CodeBlock { 1; }
flatten = List.Flatten(list=list_create, amount=code_block_3)
count = List.Count(list=flatten, lacing=Longest)
code_block_4 = CodeBlock { 4; 0; 1; }
number_slider = DoubleSlider(61, range=0..100 step 0.1)
randomList = Math.RandomList(amount=code_block_4.out0, value1=code_block_4.out1, value2=code_block_4.out2, seed=number_slider)
mul = count * randomList
floor = Math.Floor(number=mul)
getItemAtIndex = List.GetItemAtIndex(list=flatten, index=floor, lacing=Shortest)
code_block_5 = CodeBlock(l=getItemAtIndex) { h = l[0]; b = l[1]; tw = l[2]; tf = l[3]; }
code_block_6 = CodeBlock { 10; 210000; 5000; }
code_block_7 = CodeBlock(b=code_block_5.b, tf=code_block_5.tf, h=code_block_5.h, tw=code_block_5.tw, P_load=code_block_6.out0, beamLength=code_block_6.out2, EYoung=code_block_6.out1)
# ---------- code_block_7.designscript (3 lines) ----------
A_cs = 2 * (b * tf) + (h - 2 * tf) * tw;
Iy = ((b * Math.Pow(h,3)) - (b - tw) * Math.Pow((h - 2 * tf),3)) / 12;
f_max = (5 * P_load * Math.Pow(beamLength,4)) / (384 * EYoung * Iy);
# ----------------------------------------
watch = Watch(code_block_7.f_max)
watch_2 = Watch(code_block_7.Iy)
watch_3 = Watch(code_block_7.A_cs)
