# Dynamo graph Truss builder.dyn (Dynamo 2.19.3.6394)

XY = Plane.XY()
mirror = Geometry.Mirror(mirrorPlane=XY)  # unwired: geometry
number = DoubleInput(0)
start_point_bycoordinates = Point.ByCoordinates(x=number, y=number, z=number)
truss_length = DoubleInput(10)
end_geometry_translate = Geometry.Translate(geometry=start_point_bycoordinates, xTranslation=truss_length)
bottom_chord = Line.ByStartPointEndPoint(startPoint=start_point_bycoordinates, endPoint=end_geometry_translate)  # "BOTTOM CHORD ByStartPointEndPoint"
number_of_sections_number_slider = DoubleSlider(6, range=2..10 step 2)
code_block = CodeBlock(NoSections=number_of_sections_number_slider) { step = 1/NoSections; }
code_block_2 = CodeBlock(step=code_block) { [0..1..step]; }

# group: FIX VECTOR LENGTH ISSUE
code_block_3 = CodeBlock(pass=code_block_2) { _pass; }
maximumItem = List.MaximumItem(list=code_block_3)
code_block_4 = CodeBlock { 1; [1]; }
ne = maximumItem != code_block_4.out0
join = List.Join(list0=code_block_3, list1=code_block_4.out1)
if_ = RefactoredIf(test=ne, true=join, false=code_block_3)

flatten = List.Flatten(list=if_)
planeAtParameter = Curve.PlaneAtParameter(curve=bottom_chord, param=flatten)
list_create = List.Create(item0=start_point_bycoordinates, item1=end_geometry_translate)
truss_start_end_height = DoubleInput(1)
translate = Geometry.Translate(geometry=list_create, zTranslation=truss_start_end_height)
code_block_5 = CodeBlock(g=translate)
# ---------- code_block_5.designscript (3 lines) ----------
// Equivalent to List.GetItemAtIndex
g[0];
g[1];
# ----------------------------------------
code_block_6 = CodeBlock(L=truss_length) { midPoint = L/2; }
truss_midpoint_height_number = DoubleSlider(1, range=1..3 step 0.5)  # "Truss MidPoint Height Number Slider"
eq = truss_start_end_height == truss_midpoint_height_number
code_block_7 = CodeBlock(h=truss_midpoint_height_number) { h+0.0001; }
if_2 = RefactoredIf(test=eq, true=code_block_7, false=truss_midpoint_height_number)
translate_2 = Geometry.Translate(geometry=start_point_bycoordinates, xTranslation=code_block_6, zTranslation=if_2)
top_chord_guide_arc = Arc.ByThreePoints(firstPoint=code_block_5.out1, secondPoint=translate_2, thirdPoint=code_block_5.out0)
intersectAll = Geometry.IntersectAll(geometry=planeAtParameter, others=top_chord_guide_arc)
flatten_2 = List.Flatten(list=intersectAll)
restOfItems = List.RestOfItems(list=flatten_2)
top_chord_line = Line.ByStartPointEndPoint(startPoint=flatten_2, endPoint=restOfItems)
intersectAll_2 = Geometry.IntersectAll(geometry=planeAtParameter, others=bottom_chord)
flatten_3 = List.Flatten(list=intersectAll_2)
code_block_8 = CodeBlock { 2; 1; }
dropEveryNthItem = List.DropEveryNthItem(list=flatten_3, n=code_block_8.out0, offset=code_block_8.out1)
code_block_9 = CodeBlock { 2; 0; }
dropEveryNthItem_2 = List.DropEveryNthItem(list=flatten_2, n=code_block_9.out0, offset=code_block_9.out1)
diagonal_1_members_line = Line.ByStartPointEndPoint(startPoint=dropEveryNthItem, endPoint=dropEveryNthItem_2)
restOfItems_2 = List.RestOfItems(list=dropEveryNthItem_2)
diagonal_2_members_line = Line.ByStartPointEndPoint(startPoint=dropEveryNthItem, endPoint=restOfItems_2)
vertical_members_line = Line.ByStartPointEndPoint(startPoint=flatten_3, endPoint=flatten_2)
code_block_10 = CodeBlock(TopChord=top_chord_line, BottonChord=bottom_chord, DiagFirst=diagonal_1_members_line, DiagSecond=diagonal_2_members_line, VertMembers=vertical_members_line)
# ---------- code_block_10.designscript (7 lines) ----------
// ALL MEMBERS

_TopChord;
_BottonChord;
_DiagFirst;
_DiagSecond;
_VertMembers;
# ----------------------------------------
list_create_2 = List.Create(item0=code_block_10._TopChord, item1=code_block_10._BottonChord, item2=code_block_10._DiagFirst, item3=code_block_10._DiagSecond, item4=code_block_10._VertMembers)
