# Dynamo graph Warren bridge truss.dyn (Dynamo 2.19.3.6394)

inverted_geometry_midpoint_1 = BoolSelector(false)  # "Inverted Geometry (MidPoint = 1) Boolean"
truss_midpoint_height_number = DoubleSlider(1, range=1..3 step 0.5)  # "Truss MidPoint Height Number Slider"
code_block = CodeBlock(TMP=truss_midpoint_height_number) { TMP; 1; }
eq = Equals(x=code_block.TMP, y=code_block.out1)
and_ = And(bool0=inverted_geometry_midpoint_1, bool1=eq)
number = DoubleInput(0)
start_point_bycoordinates = Point.ByCoordinates(x=number, y=number, z=number)
truss_length = DoubleInput(10)
end_geometry_translate = Geometry.Translate(geometry=start_point_bycoordinates, xTranslation=truss_length)
bottom_chord_guide = Line.ByStartPointEndPoint(startPoint=start_point_bycoordinates, endPoint=end_geometry_translate)  # "BOTTOM CHORD GUIDE ByStartPointEndPoint"
number_of_sections_number_slider = DoubleSlider(4, range=4..12 step 2)
code_block_2 = CodeBlock(NoSections=number_of_sections_number_slider) { step = 1/NoSections; }
code_block_3 = CodeBlock(step=code_block_2) { [0..1..step]; }

# group: FIX VECTOR LENGTH ISSUE
code_block_4 = CodeBlock(pass=code_block_3) { _pass; }
maximumItem = List.MaximumItem(list=code_block_4)
code_block_5 = CodeBlock { 1; [1]; }
ne = maximumItem != code_block_5.out0
join = List.Join(list0=code_block_4, list1=code_block_5.out1)
if_ = RefactoredIf(test=ne, true=join, false=code_block_4)

flatten = List.Flatten(list=if_)
planeAtParameter = Curve.PlaneAtParameter(curve=bottom_chord_guide, param=flatten)
intersectAll = Geometry.IntersectAll(geometry=planeAtParameter, others=bottom_chord_guide)
bottom_points_list_flatten = List.Flatten(list=intersectAll)
restOfItems = List.RestOfItems(list=bottom_points_list_flatten)
bottom_chord_line = Line.ByStartPointEndPoint(startPoint=bottom_points_list_flatten, endPoint=restOfItems)
list_create = List.Create(item0=start_point_bycoordinates, item1=end_geometry_translate)
truss_start_end_height = DoubleInput(1)
translate = Geometry.Translate(geometry=list_create, zTranslation=truss_start_end_height)
code_block_6 = CodeBlock(g=translate)
# ---------- code_block_6.designscript (3 lines) ----------
// Equivalent to List.GetItemAtIndex
g[0];
g[1];
# ----------------------------------------
code_block_7 = CodeBlock(L=truss_length) { midPoint = L/2; }
eq_2 = truss_start_end_height == truss_midpoint_height_number
code_block_8 = CodeBlock(h=truss_midpoint_height_number) { h+0.0001; }
if_2 = RefactoredIf(test=eq_2, true=code_block_8, false=truss_midpoint_height_number)
translate_2 = Geometry.Translate(geometry=start_point_bycoordinates, xTranslation=code_block_7, zTranslation=if_2)
top_chord_guide_arc = Arc.ByThreePoints(firstPoint=code_block_6.out1, secondPoint=translate_2, thirdPoint=code_block_6.out0)
intersectAll_2 = Geometry.IntersectAll(geometry=planeAtParameter, others=top_chord_guide_arc)
top_points_list_flatten = List.Flatten(list=intersectAll_2)
restOfItems_2 = List.RestOfItems(list=top_points_list_flatten)
code_block_9 = CodeBlock { -1; }
dropItems = List.DropItems(list=restOfItems_2, amount=code_block_9)
restOfItems_3 = List.RestOfItems(list=dropItems)
top_chord_line = Line.ByStartPointEndPoint(startPoint=dropItems, endPoint=restOfItems_3)
code_block_10 = CodeBlock { 2; 0; }
dropEveryNthItem = List.DropEveryNthItem(list=bottom_points_list_flatten, n=code_block_10.out0, offset=code_block_10.out1)
code_block_11 = CodeBlock { 2; 1; }
dropEveryNthItem_2 = List.DropEveryNthItem(list=top_points_list_flatten, n=code_block_11.out0, offset=code_block_11.out1)
diagonal_1_members_line = Line.ByStartPointEndPoint(startPoint=dropEveryNthItem, endPoint=dropEveryNthItem_2)
restOfItems_4 = List.RestOfItems(list=dropEveryNthItem)
diagonal_2_members_line = Line.ByStartPointEndPoint(startPoint=dropEveryNthItem_2, endPoint=restOfItems_4)
list_create_2 = List.Create(item0=diagonal_1_members_line, item1=diagonal_2_members_line)
transpose = List.Transpose(lists=list_create_2)
code_block_12 = CodeBlock(diagonals_in_order=transpose) { _diagonals_in_order; }
restOfItems_5 = List.RestOfItems(list=bottom_points_list_flatten)
code_block_13 = CodeBlock { -1; }
dropItems_2 = List.DropItems(list=restOfItems_5, amount=code_block_13)
vertical_members_line = Line.ByStartPointEndPoint(startPoint=dropItems_2, endPoint=dropItems)
code_block_14 = CodeBlock(BottonChord=bottom_chord_line, TopChord=top_chord_line, Diagonals=code_block_12, VertMembers=vertical_members_line)
# ---------- code_block_14.designscript (5 lines) ----------
// ALL MEMBERS
_BottonChord;
_TopChord;
_Diagonals;
_VertMembers;
# ----------------------------------------
join_2 = List.Join(list0=code_block_14._BottonChord, list1=code_block_14._TopChord, list2=code_block_14._Diagonals, list3=code_block_14._VertMembers)
flatten_2 = List.Flatten(list=join_2)
XY = Plane.XY()
mirror = Geometry.Mirror(geometry=flatten_2, mirrorPlane=XY)
if_3 = RefactoredIf(test=and_, true=mirror, false=flatten_2)
flatten_3 = List.Flatten(list=if_3)
number_slider = DoubleSlider(6, range=0..13 step 1)
getItemAtIndex = List.GetItemAtIndex(index=number_slider)  # unwired: list
color_palette = ColorPalette({R: 0, G: 255, B: 255, A: 255})
byGeometryColor = Modifiers.GeometryColor.ByGeometryColor(geometry=getItemAtIndex, color=color_palette)
code_block_15 = CodeBlock(BottonChord=code_block_14._BottonChord, TopChord=code_block_14._TopChord, Diagonals=code_block_14._Diagonals, VertMembers=code_block_14._VertMembers)  # same code as code_block_14
startPoint = Curve.StartPoint(curve=code_block_15._BottonChord)
endPoint = Curve.EndPoint(curve=code_block_15._BottonChord)
join_3 = List.Join(list0=startPoint, list1=endPoint)
pruneDuplicates = Point.PruneDuplicates(points=join_3)
startPoint_2 = Curve.StartPoint(curve=code_block_15._TopChord)
endPoint_2 = Curve.EndPoint(curve=code_block_15._TopChord)
join_4 = List.Join(list0=startPoint_2, list1=endPoint_2)
pruneDuplicates_2 = Point.PruneDuplicates(points=join_4)
join_5 = List.Join(list0=pruneDuplicates, list1=pruneDuplicates_2)
